# Grasshopper definition xArm6core.gh (Grasshopper 1.0.7)

# ---- group: make 3 curves
# MAKE 3 CURVES
radius_1 = Slider(88, range=20..200)
plane = Plane(PlaneXY(0, 0, 0))
half_height = Slider(35, range=20..200)
curve_height = Slider(25, range=20..200)
ellipse = Ellipse(Plane=plane, Radius1=radius_1, Radius2=Slider(36, range=20..200))  # -> Ellipse, Focus1, Focus2
vec = VectorXYZ(XComponent=Slider(0.154, range=0..1), YComponent=Slider(0, range=0..1), ZComponent=half_height)  # -> Vector, Length
_3 = Integer(3)
integer = Integer([0, 2])
_4 = Integer(4)
arrlinear = LinearArray(Geometry=ellipse.Ellipse, Direction=vec.Vector, Count=_3)  # -> Geometry, Transform
cull_i = CullIndex(List=arrlinear.Geometry, Indices=integer, Wrap=True)
divide = DivideCurve(Curve=cull_i, Count=_4, Kinks=False)  # -> Points, Tangents, Parameters
integer_2 = Integer([0, 2])
integer_3 = Integer([1, 3])
vec_2 = VectorXYZ(XComponent=Slider(0, range=0..1), YComponent=Slider(0, range=0..1), ZComponent=curve_height)  # -> Vector, Length
cull_i_2 = CullIndex(List=divide.Points, Indices=integer_3, Wrap=True)
cull_i_3 = CullIndex(List=divide.Points, Indices=integer_2, Wrap=True)
move = Move(Geometry=cull_i_3, Motion=vec_2.Vector)  # -> Geometry, Transform
integer_4 = Integer(-2)
weave = Weave(Pattern=[0, 1], Stream0=cull_i_2, Stream1=move.Geometry, NullGaps=False)
division = Division(A=curve_height, B=integer_4)
integer_5 = Integer([1, 2])
integer_6 = Integer([0, 1])
Z = UnitZ(Factor=division)
intcrv = Interpolate(Vertices=weave, Degree=3, Periodic=True, KnotStyle=1)  # -> Curve, Length, Domain
cull_i_4 = CullIndex(List=arrlinear.Geometry, Indices=integer_6, Wrap=True)
cull_i_5 = CullIndex(List=arrlinear.Geometry, Indices=integer_5, Wrap=True)
move_2 = Move(Geometry=intcrv.Curve, Motion=Z)  # -> Geometry, Transform
weave_2 = Weave(Pattern=[0, 1], Stream0=move_2.Geometry, Stream1=cull_i_5, NullGaps=False)
weave_3 = Weave(Pattern=[0, 1], Stream0=cull_i_4, Stream1=move_2.Geometry, NullGaps=False)

# ----
# BASE LAYER HEIGHT
# BASE
num = Number(1.6)
addition = Addition(A=num, B=num)

# ----
# DISTANCE TO PRINT PLATE CENTER
_200 = Integer(200)

unit_z = UnitZ(Factor=num)
unit_z_2 = UnitZ(Factor=addition)
number = Number(16.5)

# ----
# EXTRUSION MULTIPLIER
extrusion_multiplier = Slider(1.75, range=0..5)

integer_7 = Integer(0)
integer_8 = Integer(0)
big_endian = BooleanToggle(False)
slave_id = Panel("0x09")
panel = Panel("""name
has_auger
barrel_diameter
steps_per_revolution
nozzle_in_mm""")

extrusion_width = Slider(2.55, range=1..5)
neg = Negative(Value=extrusion_width)
_40 = Integer(40)
range = Range(Domain=Domain(0, 1), Steps=expr("X-1", _40))

division_2 = Division(A=extrusion_width, B=-2)
offset_curve = OffsetCurve(Curve=ellipse.Ellipse, Distance=division_2, Corners=1)

# ----
# TOP ISOCURVES
loft = Loft(Curves=weave_3, Options={Adjust=False, Closed=False, LoftEnds=0, LoftSimp=2, LoftType=0, Rebuild=10, Refit=0.01})
bbox_size_of_object = BoundingBox(Content=weave_3, Plane=PlaneXY(0, 0, 0))  # -> Box, Box_2
debox = DeconstructBox(Box=bbox_size_of_object.Box)  # -> Plane, X, Y, Z
dedomain = DeconstructDomain(Domain=debox.Z)  # -> Start, End
cull_i_6 = CullIndex(List=dedomain.End, Indices=1, Wrap=True)

# ---- group: isocurves
# BOTTOM ISOCURVES
loft_2 = Loft(Curves=weave_2, Options={Adjust=False, Closed=False, LoftEnds=0, LoftSimp=2, LoftType=0, Rebuild=10, Refit=0.01})
bbox_size_of_object_2 = BoundingBox(Content=weave_2, Plane=PlaneXY(0, 0, 0))  # -> Box, Box_2
debox_2 = DeconstructBox(Box=bbox_size_of_object_2.Box)  # -> Plane, X, Y, Z
dedomain_2 = DeconstructDomain(Domain=debox_2.Z)  # -> Start, End

# ----
area = Area(Geometry=offset_curve)  # -> Area, Centroid
crv_cp = CurveClosestPoint(Point=area.Centroid, Curve=offset_curve)  # -> Point, Parameter, Distance
division_3 = Division(A=crv_cp.Distance, B=extrusion_width)
series = Series(Start=0, Step=neg, Count=division_3)
offset = OffsetCurve(Curve=offset_curve, Distance=series, Plane=PlaneXY(0, 0, 0), Corners=2)
divide_2 = DivideCurve(Curve=offset, Count=_40, Kinks=False)  # -> Points, Tangents, Parameters
flip = FlipMatrix(Data=divide_2.Points)
pline = PolyLine(Vertices=flip, Closed=False)
explode = Explode(Curve=pline, Recursive=True)  # -> Segments, Vertices
end = EndPoints(Curve=explode.Segments)  # -> Start, End
vec2pt = Vector2Pt(PointA=end.Start, PointB=end.End, Unitize=False)  # -> Vector, Length
flip_2 = FlipMatrix(Data=vec2pt.Vector)
multiplication = Multiplication(A=flip_2, B=range)
move_3 = Move(Geometry=divide_2.Points, Motion=multiplication)  # -> flatten(Geometry), Transform

reverse_list = ReverseList(List=move_3.Geometry)
list_item = ListItem(List=move_3.Geometry, Index=0, Wrap=True)
# 1001_move_line.py: #!/usr/bin/env python3
# # Software License Agreement (BSD License)
# #
# # Copyright (c) 2019, UFACTORY, Inc.
# # All rights reserved.
# #
# # Author: Vinman <vinman.wen@ufactory.cc> <vinman.cub@gmail.com>
# 
# """
# Description: Move line(linear motion)
# """
# 
# import os
# import sys
# import time
# 
# sys.path.append(os.path.join(os.path.dirname(__file__), '../../..'))
# 
# from xarm.wrapper import XArmAPI
# 
# 
# #######################################################
# """
# Just for test example
# """
# if len(sys.argv) >= 2:
#     ip = sys.argv[1]
# else:
#     try:
#         from configparser import ConfigParser
#         parser = ConfigParser()
#         parser.read('../robot.conf')
#         ip = parser.get('xArm', 'ip')
#     except:
#         ip = input('Please input the xArm ip address:')
#         if not ip:
#             print('input error, exit')
#             sys.exit(1)
# ########################################################
# 
# 
# arm = XArmAPI(ip)
# arm.motion_enable(enable=True)
# arm.set_mode(0)
# arm.set_state(state=0)
# 
# arm.reset(wait=True)
# 
# arm.set_position(x=300, y=0, z=150, roll=-180, pitch=0, yaw=0, speed=100, wait=True)
# print(arm.get_position(), arm.get_position(is_radian=True))
# arm.set_position(x=300, y=200, z=250, roll=-180, pitch=0, yaw=0, speed=200, wait=True)
# print(arm.get_position(), arm.get_position(is_radian=True))
# arm.set_position(x=500, y=200, z=150, roll=-180, pitch=0, yaw=0, speed=300, wait=True)
# print(arm.get_position(), arm.get_position(is_radian=True))
# arm.set_position(x=500, y=-200, z=250, roll=-180, pitch=0, yaw=0, speed=400, wait=True)
# print(arm.get_position(), arm.get_position(is_radian=True))
# arm.set_position(x=300, y=-200, z=150, roll=-180, pitch=0, yaw=0, speed=500, wait=True)
# print(arm.get_position(), arm.get_position(is_radian=True))
# arm.set_position(x=300, y=0, z=250, roll=-180, pitch=0, yaw=0, speed=600, wait=True)
# print(arm.get_position(), arm.get_position(is_radian=True))
# 
# 
# arm.reset(wait=True)
# 
# arm.set_position(x=300, y=0, z=150, roll=-3.1415926, pitch=0, yaw=0, speed=100, is_radian=True, wait=True)
# print(arm.get_position(), arm.get_position(is_radian=True))
# arm.set_position(x=300, y=200, z=250, roll=-3.1415926, pitch=0, yaw=0, speed=200, is_radian=True, wait=True)
# print(arm.get_position(), arm.get_position(is_radian=True))
# arm.set_position(x=500, y=200, z=150, roll=-3.1415926, pitch=0, yaw=0, speed=300, is_radian=True, wait=True)
# print(arm.get_position(), arm.get_position(is_radian=True))
# arm.set_position(x=500, y=-200, z=250, roll=-3.1415926, pitch=0, yaw=0, speed=400, is_radian=True, wait=True)
# print(arm.get_position(), arm.get_position(is_radian=True))
# arm.set_position(x=300, y=-200, z=150, roll=-3.1415926, pitch=0, yaw=0, speed=500, is_radian=True, wait=True)
# print(arm.get_position(), arm.get_position(is_radian=True))
# arm.set_position(x=300, y=0, z=250, roll=-3.1415926, pitch=0, yaw=0, speed=600, is_radian=True, wait=True)
# print(arm.get_position(), arm.get_position(is_radian=True))
# 
# arm.reset(wait=True)
# arm.disconnect()
# 1002_move_line_py: #!/usr/bin/env python3
# # Software License Agreement (BSD License)
# #
# # Copyright (c) 2019, UFACTORY, Inc.
# # All rights reserved.
# #
# # Author: Vinman <vinman.wen@ufactory.cc> <vinman.cub@gmail.com>
# 
# """
# Description: Move line(linear motion)
# """
# 
# import os
# import sys
# import time
# 
# sys.path.append(os.path.join(os.path.dirname(__file__), '../../..'))
# 
# from xarm.wrapper import XArmAPI
# 
# 
# #######################################################
# """
# Just for test example
# """
# if len(sys.argv) >= 2:
#     ip = sys.argv[1]
# else:
#     try:
#         from configparser import ConfigParser
#         parser = ConfigParser()
#         parser.read('../robot.conf')
#         ip = parser.get('xArm', 'ip')
#     except:
#         ip = input('Please input the xArm ip address:')
#         if not ip:
#             print('input error, exit')
#             sys.exit(1)
# ########################################################
# 
# 
# arm = XArmAPI(ip, is_radian=True)
# arm.motion_enable(enable=True)
# arm.set_mode(0)
# arm.set_state(state=0)
# 
# arm.reset(wait=True)
# 
# arm.set_position(x=300, y=0, z=150, roll=-180, pitch=0, yaw=0, speed=100, is_radian=False, wait=True)
# print(arm.get_position(), arm.get_position(is_radian=False))
# arm.set_position(x=300, y=200, z=250, roll=-180, pitch=0, yaw=0, speed=200, is_radian=False, wait=True)
# print(arm.get_position(), arm.get_position(is_radian=False))
# arm.set_position(x=500, y=200, z=150, roll=-180, pitch=0, yaw=0, speed=300, is_radian=False, wait=True)
# print(arm.get_position(), arm.get_position(is_radian=False))
# arm.set_position(x=500, y=-200, z=250, roll=-180, pitch=0, yaw=0, speed=400, is_radian=False, wait=True)
# print(arm.get_position(), arm.get_position(is_radian=False))
# arm.set_position(x=300, y=-200, z=150, roll=-180, pitch=0, yaw=0, speed=500, is_radian=False, wait=True)
# print(arm.get_position(), arm.get_position(is_radian=False))
# arm.set_position(x=300, y=0, z=250, roll=-180, pitch=0, yaw=0, speed=600, is_radian=False, wait=True)
# print(arm.get_position(), arm.get_position(is_radian=False))
# 
# 
# arm.reset(wait=True)
# 
# arm.set_position(x=300, y=0, z=150, roll=-3.1415926, pitch=0, yaw=0, speed=100, wait=True)
# print(arm.get_position(), arm.get_position(is_radian=False))
# arm.set_position(x=300, y=200, z=250, roll=-3.1415926, pitch=0, yaw=0, speed=200, wait=True)
# print(arm.get_position(), arm.get_position(is_radian=False))
# arm.set_position(x=500, y=200, z=150, roll=-3.1415926, pitch=0, yaw=0, speed=300, wait=True)
# print(arm.get_position(), arm.get_position(is_radian=False))
# arm.set_position(x=500, y=-200, z=250, roll=-3.1415926, pitch=0, yaw=0, speed=400, wait=True)
# print(arm.get_position(), arm.get_position(is_radian=False))
# arm.set_position(x=300, y=-200, z=150, roll=-3.1415926, pitch=0, yaw=0, speed=500, wait=True)
# print(arm.get_position(), arm.get_position(is_radian=False))
# arm.set_position(x=300, y=0, z=250, roll=-3.1415926, pitch=0, yaw=0, speed=600, wait=True)
# print(arm.get_position(), arm.get_position(is_radian=False))
# 
# arm.reset(wait=True)
# arm.disconnect()
cherry_picker = CherryPicker(reverse_list, ListIndex=559)

# ----
# WALLS
# WALLS LAYER HEIGHT
layer_height = Number(2.15)

# ---- group: isocurves (continued)
division_4 = Division(A=dedomain_2.End, B=layer_height)
range_2 = Range(Domain=Domain(0, 1), Steps=division_4)
pt = ConstructPoint(XCoordinate=range_2, YCoordinate=0, ZCoordinate=0)
iso = IsoCurve(Surface=reparameterize(loft_2), UVPoint=pt)  # -> UIsocurve, flatten(VIsocurve)
rev = ReverseList(List=iso.VIsocurve)

# ----
division_5 = Division(A=cull_i_6, B=layer_height)
range_3 = Range(Domain=Domain(0, 1), Steps=division_5)
pt_2 = ConstructPoint(XCoordinate=range_3, YCoordinate=0, ZCoordinate=0)
iso_2 = IsoCurve(Surface=reparameterize(loft), UVPoint=pt_2)  # -> UIsocurve, flatten(VIsocurve)
rev_2 = ReverseList(List=iso_2.VIsocurve)

merge = Merge(Data1=rev, Data2=rev_2)

# ----
# MOVE TO PRINT PLATE
addition_2 = Addition(A=addition, B=layer_height)
vec_3 = VectorXYZ(XComponent=_200, YComponent=_200, ZComponent=addition_2)  # -> Vector, Length
move_up_and_to_cartesian = Move(Geometry=merge, Motion=vec_3.Vector)  # -> Geometry, Transform

# ----
# CURVES INTO POINTS
curve_points = Slider(100, range=20..200)
divide_3 = DivideCurve(Curve=move_up_and_to_cartesian.Geometry, Count=curve_points, Kinks=False)  # -> Points, flatten(Tangents), Parameters

# ----
# SEGMENT LENGTH
shift_list = ShiftList(List=divide_3.Points, Shift=1, Wrap=True)
length_of_segment = Distance(PointA=divide_3.Points, PointB=shift_list)  # -> flatten(SegmentLength)
segment_length = Expression(x=length_of_segment, Expression="Format(\"{0:0.00}\",x)")

# ----
# EXTRUSION SPEED MULTIPLIER
flip_3 = FlipMatrix(Data=divide_3.Points)
shift_list_2 = ShiftList(List=flip_3, Shift=1, Wrap=False)
explode_2 = Explode(Curve=move_up_and_to_cartesian.Geometry, Recursive=True)  # -> Segments, Vertices
line = Line(StartPoint=flip_3, EndPoint=shift_list_2)  # -> simplify(Line)
flip_4 = FlipMatrix(Data=line)
len = Length(Curve=explode_2.Segments)
length = Length(Curve=flip_4)  # -> flatten(Length)
multiplication_2 = Multiplication(A=segment_length, B=length, C=Slider(1, range=0.1..3))

unflatten_tree = UnflattenTree(Tree=segment_length, Guide=simplify(shift_list))

# ----
# HEX CONVERTER
big_endian_2 = BooleanToggle(False)
move_4 = GhPythonScript(x=segment_length, big=big_endian_2)  # -> out, a
# ---------- move_4: Python ----------
__author__ = "morr0289"
__version__ = "2023.07.05"

import rhinoscriptsyntax as rs
import math


z = int (x * 100)
h = str(hex(z))
s = h.lstrip("0x")
e = s.zfill(4)
if big:
    f = e[0]
    g = e[1]
    h = e[2]
    i = e[3]
else:
    f = e[2]
    g = e[3]
    h = e[0]
    i = e[1]
j = "0x"
k = ", "
a = j+f+g+k+j+h+i
# ---------- end move_4 ----------
move_5 = GhPythonScript(x=multiplication_2, big=big_endian_2)  # -> out, a; same code as move_4

panel_2 = Panel(unflatten_tree)
cherry_picker_2 = CherryPicker(divide_3.Points, ListIndex=0)
cherry_picker_3 = CherryPicker(line, ListIndex=0)
gcode_formatter = Expression(
    slaveid="0x09",
    move=flatten(move_4.a),
    speed=flatten(move_5.a),
    dir="0x01",
    Expression="Format(\"datas = [{0},0x10,0x00,0x00,0x00,0x03,0x06,{1},{2},0x00,{3}]\",slaveid, move, speed,dir)")

# ----
# modbus call: while arm.connected and arm.error_code == 0:
# modbus call: 0x08,0x10,(register starting address 0x00,0xC8),(number of registers 0x00,0x04),(byte count 0x08),(data X)(data Y)
gcode_formatter_2 = Expression(port="0x09", move=move_4.a, speed=move_5.a, Expression="Format(\"sender('{0}','{1}','{2}')\", port, move, speed)")

panel_3 = Panel(move_5.a)
lng = ListLength(List=gcode_formatter)
repeat = RepeatData(Data="sender(datas)", Length=lng)

# ---- group: contour base
X = UnitX(Factor=1)
contour = Contour(Shape=offset_curve, Point=Point(0, 0, 0), Direction=X, Distance=extrusion_width)
dispatch = Dispatch(List=flatten(contour), DispatchPattern=[True, False])  # -> ListA, ListB
flip_5 = FlipCurve(Curve=dispatch.ListB)  # -> Curve, Flag
weave_4 = Weave(Pattern=[0, 1], Stream0=dispatch.ListA, Stream1=flip_5.Curve, NullGaps=False)
disc = Discontinuity(Curve=weave_4, Level=1)  # -> Points, Parameters

# ----
closest_point = ClosestPoint(Point=list_item, Cloud=flatten(disc.Points))  # -> ClosestPoint, CPIndex, Distance
shift_list_3 = ShiftList(List=disc.Points, Shift=closest_point.CPIndex, Wrap=True)  # -> flatten(List)

# ---- group: contour base (continued)
pline_2 = PolyLine(Vertices=shift_list_3, Closed=False)

# ----
move_6 = Move(Geometry=pline_2, Motion=unit_z)  # -> Geometry, Transform

pline_3 = PolyLine(Vertices=reverse_list, Closed=False)

move_7 = Move(Geometry=pline_3, Motion=unit_z_2)  # -> Geometry, Transform

merge_2 = Merge(Data1=move_6.Geometry, Data2=move_7.Geometry)

# ----
# MOVE TO PRINT PLATE
vec_4 = VectorXYZ(XComponent=_200, YComponent=_200, ZComponent=integer_7)  # -> Vector, Length
move_up_and_to_cartesian_2 = Move(Geometry=merge_2, Motion=vec_4.Vector)  # -> Geometry, Transform

# ----
# BASE POINTS
explode_3 = Explode(Curve=move_up_and_to_cartesian_2.Geometry, Recursive=True)  # -> Segments, Vertices
len_2 = Length(Curve=explode_3.Segments)
multiplication_3 = Multiplication(A=len_2, B=extrusion_multiplier)

deconstruct = Deconstruct(Point=explode_3.Vertices)  # -> XComponent, YComponent, ZComponent
# POINTS TO PYTHON
gcode_formatter_3 = Expression(
    e=multiplication_3,
    x=deconstruct.XComponent,
    y=deconstruct.YComponent,
    z=deconstruct.ZComponent,
    pitch=integer_8,
    yaw=integer_8,
    roll=integer_8,
    Expression="Format(\"arm.set_position(x={0:0.00}, y={1:0.00}, z={2:0.00}, roll={3:0.00}, pitch={4:0.00}, yaw={5:0.00}, speed={6:0.00}, is_radian=False, wait=True)\", x, y, z, roll, pitch, yaw, e)")  # -> flatten(Result)
base_2_code = Panel(gcode_formatter_3)

speed = GhPythonScript(x=multiplication_3, big=big_endian)  # -> out, a; same code as move_4
move_8 = GhPythonScript(x=len_2, big=big_endian)  # -> out, a; same code as move_4
gcode_formatter_4 = Expression(
    slaveid=slave_id,
    move=flatten(move_8.a),
    speed=flatten(speed.a),
    dir="0x01",
    Expression="Format(\"datas = [{0},0x10,0x00,0x00,0x00,0x03,0x06,{1},{2},0x00,{3}]\",slaveid, move, speed, dir)")
lng_2 = ListLength(List=gcode_formatter_4)
repeat_2 = RepeatData(Data="sender(datas)", Length=lng_2)
weave_5 = Weave(Pattern=[0, 1, 2], Stream0=base_2_code, Stream1=gcode_formatter_4, Stream2=repeat_2, NullGaps=False)
weave_6 = Weave(Pattern=[0, 2], Stream0=gcode_formatter_4, Stream1=base_2_code, Stream2=repeat_2, NullGaps=False)

# ----
# EXTRUSION
deconstruct_2 = Deconstruct(Point=divide_3.Points)  # -> XComponent, YComponent, ZComponent

gcode_formatter_5 = Expression(
    e=number,
    x=deconstruct_2.XComponent,
    y=deconstruct_2.YComponent,
    z=deconstruct_2.ZComponent,
    Expression="Format(\"arm.set_position(x={0:0.00}, y={1:0.00}, z={2:0.00}, roll={3:0.00}, pitch={4:0.00}, yaw={5:0.00}, speed={6:0.00}, is_radian=False, wait=True)\", x, y, z, roll, pitch, yaw, e)")  # -> flatten(Result)

object_code = Panel(gcode_formatter_5)

weave_7 = Weave(Pattern=[0, 1], Stream0=gcode_formatter_5, Stream1=gcode_formatter, Stream2=repeat, NullGaps=False)

header3 = Panel("""#arm.set_tcp_load()  DO THIS*****************************
#arm.set_tcp_offset()
#arm.set_collision_tool_model
arm.motion_enable(True)
arm.set_mode(0)
arm.set_state(0)

if arm.warn_code != 0:
    arm.clean_warn()
if arm.error_code != 0:
    arm.clean_error()
time.sleep(2)

ret = arm.core.set_modbus_timeout(5)  
print('set modbus timeout, ret = %d' % (ret[0]))    
ret = arm.core.set_modbus_baudrate(9600)  
print('set modbus baudrate, ret = %d' % (ret[0]))    

   

def sender(data_frame):
    ret = arm.core.getset_tgpio_modbus_data(data_frame,len(data_frame))
    print('set modbus, ret = %d' % (ret[0]))


arm.motion_enable(enable=True)
arm.set_mode(0)
arm.set_state(state=0)""")
_1001_move_line_py = Panel("""#code generated with Grasshopper for Rhino
#Chris Morrey

import os
import sys
import time
import math

sys.path.append("C:\\Users\\morr0289\\Documents\\Github\\RobotArm\\Python\\")

from arm_sdk3.xarm.wrapper.xarm_api import XArmAPI""")
expression = Expression(x="192.168.1.196", Expression="Format(\"arm = XArmAPI('{0}')\", x)")
robot_footer = Panel("""arm.reset(wait=True)
arm.disconnect()""")
# Modbus only, for testing
merge_3 = Merge(Data1=_1001_move_line_py, Data2=expression, Data3=header3)
merge_4 = Merge(Data1=merge_3, Data3=weave_5, Data4=weave_7, Data5=robot_footer)  # -> flatten(Result)
panel_4 = Panel(merge_4)

merge_5 = Merge(Data1=merge_3, Data2=weave_6, Data3=robot_footer)  # -> flatten(Result)
panel_5 = Panel(merge_5)
